# Grasshopper definition 2D Truss optimizatoin using graphic statics .gh (Grasshopper 1.0.7)
# plug-ins: 3D Graphic Statics V02, Pufferfish

pt = ConstructPoint(XCoordinate=0, YCoordinate=0, ZCoordinate=0)
number_slider = Slider(4000, range=0..10000)
truss_height = Slider(5, range=2..6)
truss_selector = Slider(2, range=0..2)
curve_factor = Slider(0, range=0..4)
total_span = Slider(20000, range=0..100000)
total_span_2 = Number(total_span)
division = Division(TrussSpan=total_span_2, B=2)
X = UnitX(Factor=total_span_2)
move = Move(Geometry=pt, Motion=X)  # -> Geometry, Transform
base_line = Line(StartPoint=pt, EndPoint=move.Geometry)

# ---- group: BOUNDING RECTANGLE
# TRUSS - TOP BOTTOM AND VERTICAL CHORDS
division_2 = Division(A=number_slider, B=2)
division_3 = Division(A=number_slider, B=2)
multiplication = Multiplication(A=division_3, B=Slider(20, range=0..100))
vec = VectorXYZ(XComponent=division_2, YComponent=0, ZComponent=division_2)  # -> Vector, Length
vec_2 = VectorXYZ(XComponent=division_3, YComponent=0, ZComponent=multiplication)  # -> Vector, Length
neg = Negative(Value=vec.Vector)
start_point = Point(pt)
end_point = Point(move.Geometry)
move_2 = Move(Geometry=start_point, Motion=neg)  # -> Geometry, Transform
move_3 = Move(Geometry=end_point, Motion=vec_2.Vector)  # -> Geometry, Transform
xz = XZPlane(Origin=Point(0, 0, 0))
rec_2pt = Rectangle2Pt(Plane=xz, PointA=move_2.Geometry, PointB=move_3.Geometry, Radius=0)  # -> Rectangle, Length

# ---- group: TRUSS CURVE
division_4 = Division(A=total_span_2, B=10000)
expression = Expression(x=curve_factor, y=division_4, Expression="if(x>y*2,y*2,x)")
division_5 = Division(A=expression, B=Slider(100000, range=0..100000))

# ----
span_no = Slider(6, range=4..12)
no_of_spans = Number(span_no)
divide = DivideCurve(Curve=base_line, SpanNo=no_of_spans, Kinks=False)  # -> Points, Tangents, Parameters
base_pts_center = CullIndex(List=divide.Points, Indices=[Slider(0, range=0..100), no_of_spans], Wrap=True)
pdecon = Deconstruct(Point=base_pts_center)  # -> XComponent, YComponent, ZComponent

# ---- group: REGION LINES AT FORCE LOCATION
Z = UnitZ(Factor=1)
base_points = Point(divide.Points)
neg_2 = Negative(Value=Z)
line = LineSDL(Start=base_points, Direction=neg_2, Length=number_slider)

# ----
list = ValueList({"PRATT TRUSS": 0, "HOWE TRUSS": 1, "WARREN TRUSS": 2}, selected="WARREN TRUSS")
multiplication_2 = Multiplication(A=truss_height, B=1000)
truss_height_2 = Number(multiplication_2)
vec_3 = VectorXYZ(XComponent=division, YComponent=0, ZComponent=truss_height_2)  # -> Vector, Length
move_4 = Move(Geometry=pt, Motion=vec_3.Vector)  # -> Geometry, Transform
truss_height_3 = Number(truss_height_2)
expression_2 = Expression(depth=truss_height_3, x=pdecon.XComponent, a=division_5, span=total_span_2, Expression="depth-a*(span/2-x)²")
vec_4 = VectorXYZ(XComponent=0, YComponent=0, ZComponent=expression_2)  # -> Vector, Length
uppper_pts = Move(Geometry=base_pts_center, Motion=vec_4.Vector)  # -> Geometry, Transform
vertical_chords = Line(StartPoint=base_pts_center, EndPoint=uppper_pts.Geometry)

# ---- group: END LINES
lng = ListLength(List=uppper_pts.Geometry)
subtraction = Subtraction(A=lng, B=1)
item = ListItem(List=uppper_pts.Geometry, Index=Slider(0, range=0..100), Wrap=True)
item_2 = ListItem(List=uppper_pts.Geometry, Index=subtraction, Wrap=True)
line_2 = Line(StartPoint=pt, EndPoint=item)
line_3 = Line(StartPoint=item_2, EndPoint=move.Geometry)
endlines = Line([line_2, line_3])

# ---- group: TOP CHORDS
pt_2 = Point(uppper_pts.Geometry)
shift = ShiftList(List=pt_2, Shift=1, Wrap=False)
short = ShortestList(ListA=pt_2, ListB=shift, TrimMode=2)  # -> ListA, ListB
# TRUSS GEOMETRY
top_chords = Line(StartPoint=short.ListA, EndPoint=short.ListB)

# ---- group: LEFT STRUTS
# HOWE TRUSS
division_6 = Division(SpanNo=no_of_spans, B=2)
top_pts = Point(uppper_pts.Geometry)
bottom_pts_center = Point(base_pts_center)
split = SplitList(List=top_pts, Index=division_6)  # -> ListA, ListB
split_2 = SplitList(List=bottom_pts_center, Index=division_6)  # -> ListA, ListB
pt_3 = Point(split.ListA)
pt_4 = Point(split_2.ListA)
shift_2 = ShiftList(List=pt_3, Shift=1, Wrap=False)
short_2 = ShortestList(ListA=shift_2, ListB=pt_4, TrimMode=2)  # -> ListA, ListB
ln = Line(StartPoint=short_2.ListA, EndPoint=short_2.ListB)

# ---- group: LEFT STRUT LINES
# PRATT TRUSS
division_7 = Division(SpanNo=no_of_spans, B=2)
bottom_pts_center_2 = Point(base_pts_center)
subtraction_2 = Subtraction(A=division_7, B=1)
split_3 = SplitList(List=bottom_pts_center_2, Index=subtraction_2)  # -> ListA, ListB
top_pts_2 = Point(uppper_pts.Geometry)
split_4 = SplitList(List=top_pts_2, Index=subtraction_2)  # -> ListA, ListB
pt_5 = Point(split_3.ListB)
shift_3 = ShiftList(List=pt_5, Shift=1, Wrap=False)
pt_6 = Point(split_4.ListB)
short_3 = ShortestList(ListA=pt_6, ListB=shift_3, TrimMode=2)  # -> ListA, ListB
ln_2 = Line(StartPoint=short_3.ListA, EndPoint=short_3.ListB)

# ---- group: PRATT LEFT STRUTS
division_8 = Division(SpanNo=no_of_spans, B=2)
top_pts_3 = Point(uppper_pts.Geometry)
bottom_pts_center_3 = Point(base_pts_center)
split_5 = SplitList(List=top_pts_3, Index=division_8)  # -> ListA, ListB
split_6 = SplitList(List=bottom_pts_center_3, Index=division_8)  # -> ListA, ListB
shift_4 = ShiftList(List=split_6.ListA, Shift=1, Wrap=False)
short_4 = ShortestList(ListA=split_5.ListA, ListB=shift_4, TrimMode=2)  # -> ListA, ListB
ln_3 = Line(StartPoint=short_4.ListA, EndPoint=short_4.ListB)

# ---- group: PRATT RIGHT STRUTS
# WARREN TRUSS
division_9 = Division(SpanNo=no_of_spans, B=2)
bottom_pts_center_4 = Point(base_pts_center)
subtraction_3 = Subtraction(A=division_9, B=1)
top_pts_4 = Point(uppper_pts.Geometry)
split_7 = SplitList(List=top_pts_4, Index=subtraction_3)  # -> ListA, ListB
split_8 = SplitList(List=bottom_pts_center_4, Index=subtraction_3)  # -> ListA, ListB
shift_5 = ShiftList(List=split_7.ListB, Shift=1, Wrap=False)
short_5 = ShortestList(ListA=shift_5, ListB=split_8.ListB, TrimMode=2)  # -> ListA, ListB
ln_4 = Line(StartPoint=short_5.ListA, EndPoint=short_5.ListB)

# ---- group: WARREN CROSS STRUTS
bottom_pts_center_5 = Point(base_pts_center)
number_slider_2 = Slider(2, range=0..10)
number_slider_3 = Slider(2, range=0..10)
bottom_pts_center_6 = Point(base_pts_center)
shift_6 = ShiftList(List=bottom_pts_center_5, Shift=1, Wrap=False)
top_pts_5 = Point(uppper_pts.Geometry)
shift_7 = ShiftList(List=top_pts_5, Shift=Slider(2, range=0..10), Wrap=False)
top_pts_6 = Point(uppper_pts.Geometry)
shift_8 = ShiftList(List=bottom_pts_center_6, Shift=1, Wrap=False)
culln = CullNth(List=top_pts_6, CullFrequency=number_slider_2)
culln_2 = CullNth(List=shift_6, CullFrequency=number_slider_2)
culln_3 = CullNth(List=shift_7, CullFrequency=number_slider_3)
culln_4 = CullNth(List=shift_8, CullFrequency=number_slider_3)
short_6 = ShortestList(ListA=culln, ListB=culln_2, TrimMode=2)  # -> ListA, ListB
short_7 = ShortestList(ListA=culln_4, ListB=culln_3, TrimMode=2)  # -> ListA, ListB
ln_5 = Line(StartPoint=short_6.ListA, EndPoint=short_6.ListB)
ln_6 = Line(StartPoint=short_7.ListA, EndPoint=short_7.ListB)

# ----
# VARIABLES, GALAPAGOS AND RESULT
truss_howe = Line([vertical_chords, top_chords, endlines, ln, ln_2, base_line])
truss_pratt = Line([vertical_chords, top_chords, endlines, base_line, ln_3, ln_4])
truss_warren = Line([vertical_chords, top_chords, endlines, base_line, ln_5, ln_6])
truss_lines = StreamFilter(Gate=truss_selector, Stream0=truss_pratt, Stream1=truss_howe, Stream2=truss_warren)
boundary_rectangle = Brep(rec_2pt.Rectangle)
vertical_lines = Line(line)
galapagos = Galapagos(fitness=truss_volume, gene=[span_no, truss_height, truss_selector, curve_factor])
crv = Curve([truss_lines, boundary_rectangle, vertical_lines])
srfsplit = SurfaceSplit(Surface=boundary_rectangle, Curves=flatten(crv))
pt_7 = Point(Point(13566.19565, 0, 15919.2548))

# ---- group: REGION TAG
listdexs = ListIndices(List=srfsplit)
bpt = BrepCentroid(Brep=srfsplit)
# FORCE DIAGRAM FORMULATION
tag = TextTag(Location=bpt, Text=listdexs, Colour=RGB(33, 46, 255))

# ---- group: STARTING POINT OF FORCE DIAGRAM
end_point_2 = Point(move.Geometry)
X_2 = UnitX(Factor=Slider(12000, range=0..100000))
move_5 = Move(Geometry=end_point_2, Motion=X_2)  # -> Geometry, Transform

# ----
surfaces = Brep(srfsplit)
py_get_neighbour_region = GhPythonScript(x=surfaces, spanno=span_no)  # -> a, llist; inputs x: list of Brep, spanno: Int32
# ---------- py_get_neighbour_region: Python ----------
# get the boundary regions of a region
import rhinoscriptsyntax as rs
m=0 
k=0
ls =[]
le=[]
a = []
ll = len(x)
#llist = [rs.coercecurve(rs.IntersectBreps(x[start1],x[start2]))]
llist =[]
regdline = []
llspt = []
for i in range(0,ll):
    a.append([])
    regdline.append([])
    for j in range(0,ll):
        llspt.append([])
        if i !=j :
            brep1 = x[i]
            brep2 = x[j]
            z= rs.IntersectBreps( brep1, brep2 )
            if z:
                a[i].append(j)
                regdline[i].append(z)
                lnew= rs.coercecurve(z)
                m=0
                for k in range(0, len(llist)):
                    if rs.CurveMidPoint(lnew) == rs.CurveMidPoint(llist[k]):
                        m = 1
                if int(m) == 0:
                    llist.append(lnew)
# ---------- end py_get_neighbour_region ----------
all_lines = Line(py_get_neighbour_region.llist)
get_loads_and_out_regions = GhPythonScript(lines=all_lines, top_chord=base_line, reg=srfsplit, udl=Slider(0.4, range=0..1), span_no=span_no, span=total_span)  # -> fdl, up_reg, load_line; inputs lines: list, reg: list
# ---------- get_loads_and_out_regions: Python ----------
import rhinoscriptsyntax as rs

up_reg =[0]
bot_reg = []
def top_or_bottom():
    max_check = 0
    a=0
    for i in range(0,len(reg)):
        z= rs.SurfaceAreaCentroid(reg[i])
        zco = a*z[0][0]
        check = z[0][2] - zco
        if check <0:
            bot_reg.append(i)
        if check > 0:
            if check > max_check:
                max_check = check
                up_reg[0]=i
    return 1
top_or_bottom()

fdl = []
for i in range(0,len(lines)):
    fdl.append(321)

uload = span*udl/(span_no-1)
rxn = span*udl/2
load_line = []

def assign_load():
    for j in range(0,len(bot_reg)):
        for k in range(j,len(bot_reg)):
            curl = rs.IntersectBreps(reg[bot_reg[j]],reg[bot_reg[k]])
            if curl:
                for i in range(0,len(lines)):
                    if rs.CurveMidPoint(curl) == rs.CurveMidPoint(lines[i]):
                        fdl[i]=uload
                        load_line.append(i)
    for m in range(0,1):
        for k in bot_reg:
            curl = rs.IntersectBreps(reg[k],reg[up_reg[0]])
            if curl:
                for i in range(0,len(lines)):
                    if rs.CurveMidPoint(curl) == rs.CurveMidPoint(lines[i]):
                        fdl[i]= - rxn
                        load_line.append(i)
assign_load()
# ---------- end get_loads_and_out_regions ----------

# ---- group: LOAD TAG
item_3 = ListItem(AllLines=get_loads_and_out_regions.fdl, LoadLines=get_loads_and_out_regions.load_line, Wrap=True)
item_4 = ListItem(AllLines=all_lines, LoadLines=get_loads_and_out_regions.load_line, Wrap=True)
# VERITCES AND LINE TAGS
roundd = RoundToDecimalPlace(NumberX=item_3, DecimalPlace=Slider(2, range=0..10), RoundType=0)  # -> Rounded, Difference
curvepoint = PointOnCurve(item_4, parameter=0.821)
tag_2 = TextTag(Location=curvepoint, Text=roundd.Rounded, Colour=RGB(97, 18, 16))
symsim = SymbolSimple(Style=15, Size=12, Rotation=-1.57, Colour=RGB(255, 105, 180))
symbol = SymbolDisplay(Location=curvepoint, Display=symsim)

# ----
all_lines_2 = Line(all_lines)
truss_lines_2 = CullIndex(List=all_lines_2, Indices=flatten(get_loads_and_out_regions.load_line), Wrap=True)

# ---- group: TRUSS VERTICES
end = EndPoints(Curve=truss_lines_2)  # -> Start, End
rempts = RemoveDuplicatePoints(ListOfPoints=[end.Start, end.End], DistanceTolerance=1e-06)  # -> NewListOfPoints, IndicesI, IndicesI_2
truss_vertices = SortPoints(Points=rempts.NewListOfPoints)  # -> Points, Indices
get_vertex_list = GhPythonScript(N=Slider(25, range=0..100), region=flatten(srfsplit), vertices=flatten(truss_vertices.Points))  # -> rav; inputs N: Int32, region: list, vertices: list
# ---------- get_vertex_list: Python ----------
import rhinoscriptsyntax as rs
import Rhino.Geometry as rg

#creat points for check
regardvtx = []
for i in range(0,len(vertices)):
    regardvtx.append([])
    cv = rs.AddCircle(rs.coerce3dpoint(vertices[i]),400)
    cv=rs.RotateObject(cv,rs.coerce3dpoint(vertices[i]),1)
    vcpts = rs.DivideCurve(cv,N,True)
    for j in range(0,N):
        for k in range(0,len(region)):
            if rs.IsPointOnSurface(region[k], vcpts[j]):
                regardvtx[i].append(k)


print regardvtx
rav = []
# create vertex and region boundary matrix
for i in range(0,len(regardvtx)):
    rav.append([])
    rav[i].append(regardvtx[i][0])
    for j in range(1,len(regardvtx[i])):
        if regardvtx[i][j] != regardvtx[i][j-1]:
            rav[i].append(regardvtx[i][j])
    rav[i].append(regardvtx[i][0])
#print rav
print rav
# ---------- end get_vertex_list ----------

# ----
# MAIN SOLVER
toggle = BooleanToggle(True)
truss_lines_3 = Line(truss_lines_2)
region = Brep(srfsplit)
py_solve_gstatics = GhPythonScript(
    RUN=toggle,
    regd=py_get_neighbour_region.a,
    fd_line=all_lines,
    x=truss_lines_3,
    fdsp=move_5.Geometry,
    act_reg=region,
    lfl=get_loads_and_out_regions.fdl,
    start_reg=get_loads_and_out_regions.up_reg,
    rav=get_vertex_list)  # -> lfm, lfl, pt_fd, cline_all, graphic; inputs regd: list, fd_line: list, x: list, act_reg: list, lfl: list of Int32, rav: list
# ---------- py_solve_gstatics: Python ----------
import rhinoscriptsyntax as rs
import Rhino.Geometry as rg
import scriptcontext as sc


#Creates a copy of an array.
def copy_func(original): 
    copy = []
    print original
    for i in range(0,len(original)):
        copy.append(original[i])
    return copy
#load_vec_copy = copy_func(lfl)

#MODULE 1
#list the end and start point of lines as per their indices 
def list_endpoints(a):
    lleng = len(x)  #get length of list
    lfm = [[]]      #form diagram line endpoints -2d null matrix
    lfs=[]          #form diagram slope lines
    #Get End points of the lines in form diagram
    for i in range(0, lleng): # LOOP
        lfm.append([])  
        ls = rs.CurveStartPoint(x[i]) #get start point from force diagram
        le = rs.CurveEndPoint(x[i]) # get end point from force diagram
        lsp = rs.coerce3dpoint(ls) #convert guid to point
        lep = rs.coerce3dpoint(rs.AddPoint(le)) #convert guid to point
        lfm[i].append(lsp) #append to list of points
        lfm[i].append(lep) #append to list of points
        #get the slope of the line
        if abs(lep[0] - lsp[0]) >= 0.01:
            slope = (lsp[2]-lep[2])/(lsp[0]-lep[0])
            lfs.append(round(slope,2))
        elif abs(lep[0] - lsp[0]) <= 0.01:
            lfs.append(321)
#list_endpoints(1)

# MODULE 2
# Add length of each line in force diagram
#lfl = []  #length of each lines in force diagram
def force_list(a):
    rlen = len(fd_line)   
    for i in range(0,rlen):
        chk=0
        for j in range (0, len(y)):
            if float(i) == y[j]:
                lfl.append(z[j])
                chk =1
        if chk==0:
            lfl.append(321) 
    return lfl
#force_list(1)
#print lfl

#Create List of points(dummy) for corresponding regions in force diagram. #Points are currently in y plane. 
pt_fd = [] # force diagram region co-ordinates.
def dummy_fd_points(a):
    for i in range(0,len(regd)):
        pt_fd.append(rg.Point3d(0,1,0)) 
    pt_fd[start_reg] =rs.coerce3dpoint(fdsp)
    return pt_fd
dummy_fd_points(1)

#Create a tracker for construction line work done.
tracker_cline= [321]
# Create a list for lines in force diagram.
tracker_ptsk = [10]
fdl = []
intersecting_lines =[]
cline_all=[[],[]]

#gets the clockwise direction of regions with external loads
def clock(r1,r2):
    for i in range(0,len(rav)):
        for j in range(1,len(rav[i])):
            if rav[i][j-1] == r1:
                if rav[i][j]== r2:
                    return "anti-clock"
        for j in range(1,len(rav[i])):
            if rav[i][j-1] == r2:
                if rav[i][j]== r1:
                    return "clock"

#graphic = clock(2,10)
#print graphic
#print rav

# returns vector of intersection of regions provided
def vbregion(r1,r2): 
    curl = rs.IntersectBreps(act_reg[r1],act_reg[r2])
    curlvec = rs.VectorCreate(rs.CurveStartPoint(curl),rs.CurveEndPoint(curl))
    return curlvec

fdline_data = []
# returns line index of intersection of regions provided
def l_index(r1,r2): 
    curl = rs.IntersectBreps(act_reg[r1],act_reg[r2])
    for k in range(0,len(fd_line)):
        if rs.CurveMidPoint(curl) == rs.CurveMidPoint(fd_line[k]) : 
            line_index = k

    return line_index

#get co-ordinate of lines with known forces & draw line. 
def getcord(r1,r2):
    for i in range(0,1):
        curl_index = l_index(r1,r2)
        curl_vec = vbregion(r1,r2)
        cur_cord = pt_fd[r1]
        curl_mag = lfl[curl_index]
        curl_clock = clock(r1,r2)
        if curl_clock == "clock":
            v_clock = -1
        elif curl_clock =="anti-clock":
            v_clock= 1                    # print curl_vec
        if lfl[curl_index] != 321:
            line =rg.Line(cur_cord,curl_vec * v_clock,curl_mag)
            line_guid = sc.doc.Objects.AddLine(line)
        cord = rs.CurveEndPoint(line_guid)
        pt_fd[r2]=cord
        #tracker_ptsk.append(r2)
        return cord
#getcord(10,2):

# Draw Cline or Fxdline -with coordinate from a point. 
def lines_and_pt(curreg):
    neigh_reg =regd[curreg]
    for i in neigh_reg:
        l_cmon = l_index(i,curreg)
        if lfl[l_cmon] !=321:
            neigh_cord  = getcord(curreg,i)
            pt_fd[i] = neigh_cord
        elif lfl[l_cmon] == 321:
            r1= curreg
            r2 = i
            if pt_fd[r2][1]==1:
                curvec= vbregion(r1,r2)
                curpt = pt_fd[curreg]
                curl = rg.Line(rs.coerce3dpoint(curpt),curvec,10000)
                cline_all[0].append(curl)
                cline_index = [r1,r2]
                cline_all[1].append(cline_index)
    tracker_cline.append(curreg)
    return cline_all

def knownpts(zz):
    cur_reglist = []
    for i in range(0,len(pt_fd)):
        if pt_fd[i][1] ==0:
            a=1
            if i in tracker_cline:
                a=0
            if a==1:
                cur_reglist.append(i)
    return cur_reglist
#cur_reglist = knownpts(1)

#pick new regions to draw neighbouring or known points/ construction lines

def draw_new_region():
    cur_reglist = knownpts(1) #get known list from list of points
    for j in cur_reglist:
        lines_and_pt(j)
#draw_new_region()

#find list of intersecting regions
def intersecting_clinelist():
    int_index =[]
    in_index =[]
    int_cline =[]
    int_cline_list =[]
    for i in range(0,len(cline_all[0])):
        line1 = cline_all[1][i][0]
        line2 = cline_all[1][i][1]
        for j in range(i+1,len(cline_all[0])):
            if line1==cline_all[1][j][0]:
                index = [line2,cline_all[1][j][1]]
                in_index.append(index)
                int_cline.append([i,j,line1])
            if line1==cline_all[1][j][1]:
                index = [line2,cline_all[1][j][0]]
                in_index.append(index)
                int_cline.append([i,j,line1])
            if line2==cline_all[1][j][0]:
                index = [line1,cline_all[1][j][1]]
                in_index.append(index)
                int_cline.append([i,j,line2])
            if line2==cline_all[1][j][1]:
                index = [line1,cline_all[1][j][0]]
                in_index.append(index)
                int_cline.append([i,j,line2])
    for k in range(0,len(int_cline)):
        if rs.IntersectBreps(act_reg[in_index[k][0]],act_reg[in_index[k][1]]):
            int_index.append(in_index[k])
            int_cline_list.append(int_cline[k])
    return int_cline


#find region point - coordinate by intersection of two cosecutive regions
def pts_intersection(line1,line2,k):
    a=cline_all[0][line1]
    b=cline_all[0][line2]
    pt_intersection = rs.LineLineIntersection(a,b)
    if pt_intersection:
        pt_fd[k]=pt_intersection[0]
    return pt_intersection

#find point and add to list after intersection
def second_type_line():
    for i in range (0,20):
        in_list = intersecting_clinelist()
        for j in in_list:
            #print in_list
            pts_intersect = pts_intersection(j[0],j[1],j[2])
            #in_list = intersecting_clinelist()
            draw_new_region()
    return pts_intersect

# Create The force Diagram. 
if RUN:
    lines_and_pt(start_reg) #get the system started!!!
    second_type_line()
# ---------- end py_solve_gstatics ----------

# ---- group: TRUSS VERTICES / VERTICES TAG
listdexs_2 = ListIndices(List=truss_vertices.Indices)
# ADDITION OF BIASES TO ORIGINAL VOLUME
tag_3 = TextTag(Location=truss_vertices.Points, Text=listdexs_2, Colour=RGB(176, 176, 176))

# ---- group: FDL -REGION TAG
listdexs_3 = ListIndices(List=py_solve_gstatics.pt_fd)
tag_4 = TextTag(Location=py_solve_gstatics.pt_fd, Text=listdexs_3, Colour=RGB(14, 188, 255))

# ----
get_volume_and_line = GhPythonScript(tr_line=truss_lines_2, reg=srfsplit, pt_fd=py_solve_gstatics.pt_fd)  # -> vol, fdl_line, fdl_vtx, fdl_len; inputs tr_line: list, reg: list, pt_fd: list
# ---------- get_volume_and_line: Python ----------
import rhinoscriptsyntax as rs

fdl_len = []
fdl_vtx = []
fdl_line=[]

for i in tr_line:
    fdl_len.append(0)
    fdl_vtx.append(0)
    fdl_line.append(0)

#Generate length and vertices of force diagram.
def fdline_vertex() :
    for j in range(0,len(reg)):
        for k in range(0,len(reg)):
            curl = rs.IntersectBreps(reg[j],reg[k])
            if curl:
                for i in range(0,len(tr_line)):
                    if rs.CurveMidPoint(curl) == rs.CurveMidPoint(tr_line[i]):
                        fdl_len[i] = round(rs.Distance(pt_fd[j],pt_fd[k]))
                        fdl_vtx[i]= [j,k] 
                        fdl_line[i]= rs.AddLine(pt_fd[j],pt_fd[k])
    return fdl_len
fdline_vertex()

#get volumne of the line = lfd * ltd
vol = 0
for i in range(0,len(tr_line)):
    vol = vol + rs.CurveLength(tr_line[i])*fdl_len [i]

vol = vol/10000
# ---------- end get_volume_and_line ----------

# ---- group: PIPE TRUSS
division_10 = Division(A=get_volume_and_line.fdl_len, B=Slider(20, range=0..100))
# TRUSS FORCE PREVIEW
pipe = Pipe(Curve=truss_lines_2, Radius=division_10, Caps=2)

# ----
compressive_buckling = GhPythonScript(
    rav=get_vertex_list,
    fdl_line=get_volume_and_line.fdl_line,
    tr_line=truss_lines_2,
    fdl_vtx=get_volume_and_line.fdl_vtx,
    td_vertices=truss_vertices.Points,
    pt_fd=py_solve_gstatics.pt_fd)  # -> out, force; inputs rav: list, fdl_line: list, tr_line: list, fdl_vtx: list, td_vertices: list, pt_fd: list
# ---------- compressive_buckling: Python ----------
import rhinoscriptsyntax as rs
import Rhino.Geometry as rg
import scriptcontext as sc


c = []
point=[]
nxt_pt = []
force = []
#  create a empty compression/tension check list 1-tension, 2-compression
for i in tr_line:
    c.append(0)
    point.append(0)
    nxt_pt.append(0)
    force.append(0)

#gets the clockwise direction of regions with external loads
def clock(r1,r2,i):
    if i :
        for j in range(1,len(rav[i])):
            if rav[i][j-1] == r1:
                if rav[i][j]== r2:
                    return "anti"
        for j in range(1,len(rav[i])):
            if rav[i][j-1] == r2:
                if rav[i][j]== r1:
                    return "clock"
#clock(0,3,7)

#gets the point with highest index among end point of line
def get_point():
    for i in range(0,len(tr_line)):
        sp=rs.CurveStartPoint(tr_line[i])
        ep=rs.CurveEndPoint(tr_line[i])
        for j in range(0,len(td_vertices)):
            if rs.Distance(rs.coerce3dpoint(td_vertices[j]),sp) < 0.1:
                sp_index = j
            if rs.Distance(rs.coerce3dpoint(td_vertices[j]),ep) < 0.1:
                ep_index = j
        point[i] = max(sp_index, ep_index)
        nxt_pt[i]=min(sp_index, ep_index)
get_point()


for i in range(0,len(tr_line)):
#i=7
#if i:
    print i
    chk_pt = [0,0,0]
    sv = fdl_vtx[i][0]
    print sv
    ev =fdl_vtx[i][1]
    print ev
    print point[i]
    clockw = clock(sv,ev,point[i])
    print clockw

    if clockw == "clock":
        vec = rs.VectorCreate(pt_fd[ev],pt_fd[sv]) 
    if clockw == "anti":
        vec = rs.VectorCreate(pt_fd[sv],pt_fd[ev]) 
    print vec
    vec_len = rs.VectorLength(vec)
    print vec_len
    td_vtx = rs.coerce3dpoint(td_vertices[point[i]])
    print td_vtx
    print "td_vtx" 
    td_line_l = rs.Distance(td_vertices[point[i]],td_vertices[nxt_pt[i]])
    print td_line_l
    chk_pt[0] = td_vtx[0]+ vec[0]/vec_len*td_line_l 
    chk_pt[1] = td_vtx[1]+ vec[1]/vec_len*td_line_l  
    chk_pt[2] = td_vtx[2]+ vec[2]/vec_len*td_line_l  
    print chk_pt
    chk_dist = rs.Distance(chk_pt,td_vertices[nxt_pt[i]])
    if chk_dist < 100:
        force[i] = 1
    if chk_dist > 10:
        force[i] = 2

print force
# ---------- end compressive_buckling ----------
line_4 = Line(get_volume_and_line.fdl_line)
num = Number(get_volume_and_line.vol)
volume = Panel(num)

# ---- group: SHOW COLOR FORCES
multiplication_3 = Multiplication(TrussHeight=truss_height, B=1500)
Z_2 = UnitZ(Factor=multiplication_3)
move_6 = Move(Geometry=truss_lines_2, Motion=Z_2)  # -> Geometry, Transform
expression_3 = Expression(
    x=compressive_buckling.force,
    fdl=get_volume_and_line.fdl_len,
    y=ColourSwatch(SwatchColor=RGB(224, 29, 29)),
    z=ColourSwatch(SwatchColor=RGB(11, 9, 163)),
    w=ColourSwatch(SwatchColor=RGB(103, 255, 0)),
    Expression="if(fdl<10,w,if(x=1,y,z))")
panel = Panel(expression_3)
preview = CustomPreview(Geometry=move_6.Geometry, Material=expression_3)

# ----
buckling_bias = Slider(0.8, range=0..1)
joint_bias = Slider(0.04, range=0..0.2)

# ---- group: LINE TAG
curvepoint_2 = PointOnCurve(truss_lines_2, parameter=0.447)
listdexs_4 = ListIndices(List=truss_lines_2)
tag_5 = TextTag(Location=curvepoint_2, Text=listdexs_4, Colour=RGB(47, 39, 71))

# ---- group: FDL NAME
listdexs_5 = ListIndices(List=line_4)
midpt = CurveMiddle(Curve=line_4)
tag_6 = TextTag(Location=midpt, Text=listdexs_5, Colour=RGB(176, 176, 176))

# ----
bias_addition = GhPythonScript(
    tr_line=truss_lines_2,
    fdl_len=get_volume_and_line.fdl_len,
    force=compressive_buckling.force,
    buckling_bias=buckling_bias,
    joint_bias=joint_bias)  # -> vol; inputs tr_line: list, fdl_len: list, force: list
# ---------- bias_addition: Python ----------
import rhinoscriptsyntax as rs

#get volumne of the line = lfd * ltd
vol = 0

j_bias = joint_bias
for i in range(0,len(tr_line)):
    if force[i] == 2:
        b_bias= buckling_bias
    if force[i] == 1:
        b_bias = 1
    vol = vol + rs.CurveLength(tr_line[i])*fdl_len[i]* (1+(1-b_bias)+j_bias) 

vol = vol/10000
print vol
# ---------- end bias_addition ----------
volume_2 = Panel(bias_addition)
tag_7 = TextTag(Location=pt_7, Text=volume_2)
truss_volume = Number(bias_addition)
